# Grasshopper definition Buildings_CEM.gh (Grasshopper 1.0.7)
# plug-ins: Kangaroo2 Components, CEM_Calculate_Structure

grid_size_y_m = Panel("""3.0
4.0
5.0""")
number_of_floors = Panel("10")
floor_heights_m = Panel("""4.0
4.5
5.0""")
slab_force_patterns = Panel("""0
1
2
3
4""")
slab_forces_kn = Panel("""-0.5
0.5""")
grid_size_x_m = Panel("""3.0
4.0
5.0""")
# Inputs for Random Variation
originpt = ConstructPoint(XCoordinate=0, YCoordinate=0, ZCoordinate=0)
int1_noofloors = Integer(number_of_floors)
int1_patterns = Integer(slab_force_patterns)
db1_floors = Number(floor_heights_m)
pt = Point(originpt)
grid_x = Number(grid_size_x_m)
grid_y = Number(grid_size_y_m)

db1_forces = Number(slab_forces_kn)
csv_reader = GhPythonScript(label="20", n0="Admin", n1="210425_data_00_CEM.csv")  # -> out, FloorHeights, SlabForces, Grid_X, Grid_Y; inputs label: Int32
# ---------- csv_reader: Python ----------
import os
import csv



with open(os.path.join('C:\\Users\\' + n0 + '\\Desktop\\AAG2020_WS4\\CEM\\Data', n1)) as csvfile:
    reader = csv.reader(csvfile, delimiter=',')
    data = [row for row in reader]
    
    nF = data[label][0]
    nF = int(float(str(nF)))
    nD = data[label][3]
    nD = int(float(str(nD)))

    FloorHeights = [floorHeight for floorHeight in data[label][11:11+nF]]
    Grid_X = data[label][4]
    Grid_Y = data[label][5]
    SlabForces = [floorHeight for floorHeight in data[label][-nD:]]
# ---------- end csv_reader ----------
value_generator = GhPythonScript(
    int1_NooFloors=int1_noofloors,
    db1_FloorHeights=db1_floors,
    int1_Patterns=int1_patterns,
    db1_Forces=db1_forces,
    db1_GridX=grid_x,
    db1_GridY=grid_y)  # -> out, int0_Floors, db1_FloorHeightsOut, int1_PatternsOut, db2_ForcesOutOut, db1_GridXOut, db1_GridYOut; inputs int1_NooFloors: list, db1_FloorHeights: list, int1_Patterns: list, db1_Forces: list, db1_GridX: list, db1_GridY: list
# ---------- value_generator: Python ----------
__author__ = "opatrick"
__version__ = "2020.03.19"


import Grasshopper, GhPython
import System
import rhinoscriptsyntax as rs
import Rhino.Geometry as rh
import random

def ListListToList(xx2_Data):
    xx1_DataOut = []
    for xx1_Data in xx2_Data:
        xx1_DataOut.extend(xx1_Data)
    return xx1_DataOut

# No of Floors
int0_lenFloors = len(int1_NooFloors)
int0_Floors= int1_NooFloors[random.randint(0,int0_lenFloors-1)]


# Floor Heights
db1_FloorHeightsOut = []
int0_FloorHeights = len(db1_FloorHeights)
for i in range(int0_Floors):
    db0_FloorHeights= db1_FloorHeights[random.randint(0,int0_FloorHeights-1)]
    db1_FloorHeightsOut.append(db0_FloorHeights)

# Patterns each floor
int1_PatternsOut = []
int0_Patterns = len(int1_Patterns)
for i in range(int0_Floors):
    int0_PatternsIS= int1_Patterns[random.randint(0,int0_Patterns-1)]
    int1_PatternsOut.append(int0_PatternsIS)

print int1_PatternsOut
# Forces in each slab/floor
db2_ForcesOut = []
int0_Forces = len(db1_Forces)
for i in range(int0_Floors):
    db1_ForcesOut = [0.01] * 24
    # pattern 0
    if int1_PatternsOut[i] == 0:
        db1_ForcesOut[0] = db1_ForcesOut[3] = db1_ForcesOut[8] = db1_ForcesOut[11] = (i+1)*db1_Forces[random.randint(0,int0_Forces-1)]
        db1_ForcesOut[1] = db1_ForcesOut[2] = db1_ForcesOut[9] = db1_ForcesOut[10] = (i+1)*db1_Forces[random.randint(0,int0_Forces-1)]
        db1_ForcesOut[4] = db1_ForcesOut[7] = (i+1)*db1_Forces[random.randint(0,int0_Forces-1)]
        db1_ForcesOut[5] = db1_ForcesOut[6] = (i+1)*db1_Forces[random.randint(0,int0_Forces-1)]
        db2_ForcesOut.append(db1_ForcesOut)
    # pattern 1
    if int1_PatternsOut[i] == 1:
        db1_ForcesOut[12] = db1_ForcesOut[15] = db1_ForcesOut[20] = db1_ForcesOut[23] = (i+1)*db1_Forces[random.randint(0,int0_Forces-1)]
        db1_ForcesOut[13] = db1_ForcesOut[14] = db1_ForcesOut[21] = db1_ForcesOut[22] = (i+1)*db1_Forces[random.randint(0,int0_Forces-1)]
        db1_ForcesOut[16] = db1_ForcesOut[19] = (i+1)*db1_Forces[random.randint(0,int0_Forces-1)]
        db1_ForcesOut[17] = db1_ForcesOut[18] = (i+1)*db1_Forces[random.randint(0,int0_Forces-1)]
        db2_ForcesOut.append(db1_ForcesOut)
    # pattern 2
    if int1_PatternsOut[i] == 2:
        db1_ForcesOut[0] = db1_ForcesOut[3] = db1_ForcesOut[8] = db1_ForcesOut[11] = db1_ForcesOut[12] = db1_ForcesOut[15] = db1_ForcesOut[20] = db1_ForcesOut[23] = (i+1)*db1_Forces[random.randint(0,int0_Forces-1)]
        db1_ForcesOut[1] = db1_ForcesOut[2] = db1_ForcesOut[9] = db1_ForcesOut[10] = db1_ForcesOut[13] = db1_ForcesOut[14] = db1_ForcesOut[21] = db1_ForcesOut[22] = (i+1)*db1_Forces[random.randint(0,int0_Forces-1)]
        db1_ForcesOut[4] = db1_ForcesOut[7] = db1_ForcesOut[16] = db1_ForcesOut[19] = (i+1)*db1_Forces[random.randint(0,int0_Forces-1)]
        db1_ForcesOut[5] = db1_ForcesOut[6] = db1_ForcesOut[17] = db1_ForcesOut[18] = (i+1)*db1_Forces[random.randint(0,int0_Forces-1)]
        db2_ForcesOut.append(db1_ForcesOut)
    # pattern 3
    if int1_PatternsOut[i] == 3:
        db1_ForcesOut[0] = db1_ForcesOut[1] = db1_ForcesOut[2] = db1_ForcesOut[3] = db1_ForcesOut[8] = db1_ForcesOut[9] = db1_ForcesOut[10] = db1_ForcesOut[11] = (i+1)*db1_Forces[random.randint(0,int0_Forces-1)]
        db1_ForcesOut[4] = db1_ForcesOut[5] = db1_ForcesOut[6] = db1_ForcesOut[7] = (i+1)*db1_Forces[random.randint(0,int0_Forces-1)]
        db2_ForcesOut.append(db1_ForcesOut)
    # pattern 4
    if int1_PatternsOut[i] == 4:
        db1_ForcesOut[12] = db1_ForcesOut[13] = db1_ForcesOut[14] = db1_ForcesOut[15] = db1_ForcesOut[20] = db1_ForcesOut[21] = db1_ForcesOut[22] = db1_ForcesOut[23] = (i+1)*db1_Forces[random.randint(0,int0_Forces-1)]
        db1_ForcesOut[16] = db1_ForcesOut[17] = db1_ForcesOut[18] = db1_ForcesOut[19] = (i+1)*db1_Forces[random.randint(0,int0_Forces-1)]
        db2_ForcesOut.append(db1_ForcesOut)
db2_ForcesOutOut = ListListToList(db2_ForcesOut)
# Grid Size
int0_len = len(db1_GridX)
db1_GridXOut = db1_GridX[random.randint(0,int0_len-1)]
int0_len = len(db1_GridY)
db1_GridYOut = db1_GridY[random.randint(0,int0_len-1)]
# ---------- end value_generator ----------
pt_2 = Point(pt)
csv_reader_2 = GhPythonScript(label="100", n0="Admin", n1="210425_data_00_CEM.csv")  # -> out, FloorHeights, SlabForces, Grid_X, Grid_Y; inputs label: Int32; same code as csv_reader
floorheights = Number(csv_reader_2.FloorHeights)
slabforces = Number(csv_reader_2.SlabForces)
grid_x_2 = Number(csv_reader_2.Grid_X)
grid_y_2 = Number(csv_reader_2.Grid_Y)

number_slider = Slider(4, range=0..10)
# Preparation of Topology
ma = MassAddition(Input=floorheights)  # -> Result, PartialResults
cell = Rectangle(Plane=pt_2, XSize=grid_x_2, YSize=grid_y_2, Radius=0)  # -> Rectangle, Length
Z = UnitZ(Factor=ma.PartialResults)
rec = Rectangle(cell.Rectangle)
arrrec = RectangularArray(Geometry=pt_2, Cell=rec, XCount=number_slider, YCount=number_slider)  # -> Geometry, Transform
move = Move(Geometry=arrrec.Geometry, Motion=graft(Z))  # -> Geometry, Transform
merge = Merge(Data1=flatten(arrrec.Geometry), Data2=flatten(move.Geometry))
lng = ListLength(List=arrrec.Geometry)
partition = PartitionList(List=merge, Size=lng)
flip = FlipMatrix(Data=partition)
rev = ReverseList(List=flip)
pline = PolyLine(Vertices=rev, Closed=False)
explode = Explode(Curve=pline, Recursive=True)  # -> Segments, Vertices
pt_3 = Point(explode.Vertices)
flip_2 = FlipMatrix(Data=pt_3)
python = GhPythonScript(points=flatten(flip_2))  # -> out, ln1_devEdges; inputs points: list of Point3d
# ---------- python: Python ----------
__author__ = "opatrick"
__version__ = "2020.03.19"


import Grasshopper, GhPython
import System
import rhinoscriptsyntax as rs
import Rhino.Geometry as rh
import random

length = len(points)
storeys = int(length/16)

ln1_devEdges = []
dball_magnitudes = []


for i in xrange(0,storeys-1,1):
    ln1_devEdges.append(rh.Line(points[0+(i*16)],points[4+(i*16)]))
    ln1_devEdges.append(rh.Line(points[1+(i*16)],points[5+(i*16)]))
    ln1_devEdges.append(rh.Line(points[2+(i*16)],points[6+(i*16)]))
    ln1_devEdges.append(rh.Line(points[3+(i*16)],points[7+(i*16)]))
    ln1_devEdges.append(rh.Line(points[4+(i*16)],points[8+(i*16)]))
    ln1_devEdges.append(rh.Line(points[5+(i*16)],points[9+(i*16)]))
    ln1_devEdges.append(rh.Line(points[6+(i*16)],points[10+(i*16)]))
    ln1_devEdges.append(rh.Line(points[7+(i*16)],points[11+(i*16)]))
    ln1_devEdges.append(rh.Line(points[8+(i*16)],points[12+(i*16)]))
    ln1_devEdges.append(rh.Line(points[9+(i*16)],points[13+(i*16)]))
    ln1_devEdges.append(rh.Line(points[10+(i*16)],points[14+(i*16)]))
    ln1_devEdges.append(rh.Line(points[11+(i*16)],points[15+(i*16)]))
    
    ln1_devEdges.append(rh.Line(points[0+(i*16)],points[1+(i*16)]))
    ln1_devEdges.append(rh.Line(points[4+(i*16)],points[5+(i*16)]))
    ln1_devEdges.append(rh.Line(points[8+(i*16)],points[9+(i*16)]))
    ln1_devEdges.append(rh.Line(points[12+(i*16)],points[13+(i*16)]))
    ln1_devEdges.append(rh.Line(points[1+(i*16)],points[2+(i*16)]))
    ln1_devEdges.append(rh.Line(points[5+(i*16)],points[6+(i*16)]))
    ln1_devEdges.append(rh.Line(points[9+(i*16)],points[10+(i*16)]))
    ln1_devEdges.append(rh.Line(points[13+(i*16)],points[14+(i*16)]))
    ln1_devEdges.append(rh.Line(points[2+(i*16)],points[3+(i*16)]))
    ln1_devEdges.append(rh.Line(points[6+(i*16)],points[7+(i*16)]))
    ln1_devEdges.append(rh.Line(points[10+(i*16)],points[11+(i*16)]))
    ln1_devEdges.append(rh.Line(points[14+(i*16)],points[15+(i*16)]))
# ---------- end python ----------
series = Series(Start=0, Step=1, Count=lng)
end = EndPoints(Curve=pline)  # -> Start, End
originpt_2 = Point(end.Start)
int = Integer(series)
devedges = Line(python.ln1_devEdges)
slabforces_2 = Number(slabforces)
trails = Curve(explode.Segments)
# CEM - Release 1.75
# If you use the library of CEM in a project, please refer to the CEM GitHub repository:
# 
# @Misc{cem2019,
# author = {Ohlbrock, Patrick Ole and D'Acunto, Pierluigi},
# title = {{CEM: Combinatorial Equilibrium Modeling}},
# year = {2019},
# note = {Release 1.75},
# url = { http://github.com/OleOhlbrock/CEM },
# }
tag = TextTag(Location=flatten(originpt_2), Text=int, Colour=RGB(15, 17, 11))

# ---- group: CEM_Build_Topology
number_slider_2 = Slider(0, range=-10..10)
number_slider_3 = Slider(0, range=-10..10)
number_slider_4 = Slider(-10, range=-10..10)
# CEM - Release 1.75
number_slider_5 = Slider(-3, range=-10..10)
# CEM - Build Topology
trailedgetower = Curve(flatten(trails))
pointload = Point(flatten(pt_3))
support = Point()
cem_deviation = GhPythonScript(deviationEdge=flatten(devedges), deviationMagn=flatten(slabforces_2))  # -> D; inputs deviationEdge: list of Curve, deviationMagn: list
# ---------- cem_deviation: Python ----------
"""
Defines a new deviation object from inputs
    Inputs:
        deviationEdge: (curves) The curves that define the deviation members in the topological diagram
        deviationMagn: (float) The force magnitudes of the deviation members [kN] (tension-positive, compression-negative) 
    Outputs:
        D: (deviationObject) The constructed deviation object
    Remarks:
        This generates a new instance of the deviation object
"""

class Deviation(object):
    def __repr__(self):
        return self.ToString()
        
    def __str__(self):
        return self.ToString()
        
    def ToString(self):
        if deviationEdge:
            return "Deviation Member"



if deviationEdge:
    D = Deviation()
    D.geom = []
    D.magn = []
    
    if deviationMagn:
        if len(deviationEdge) == len(deviationMagn):
            deviationMagnC = []
            for i in range(len(deviationEdge)):
                deviationMagnC.append( deviationMagn[i] )
            D.geom = deviationEdge
            D.magn = deviationMagnC
        elif len(deviationMagn) == 1:
            deviationMagnC = []
            for i in range(len(deviationEdge)):
                deviationMagnC.append( deviationMagn[0] )
            D.geom = deviationEdge
            D.magn = deviationMagnC
        else:
            deviationMagnC = []
            for i in range(len(deviationEdge)):
                deviationMagnC.append( 1 )
            D.geom = deviationEdge
            D.magn = deviationMagnC
    else:
        deviationMagnC = []
        for i in range(len(deviationEdge)):
            deviationMagnC.append( 1 )
        D.geom = deviationEdge
        D.magn = deviationMagnC
# ---------- end cem_deviation ----------
cem_load = GhPythonScript(
    pointLoad=flatten(pointload),
    loadMagnX=flatten(number_slider_2),
    loadMagnY=flatten(number_slider_3),
    loadMagnZ=flatten(number_slider_4))  # -> L; inputs pointLoad: list of Point3d, loadMagnX: list, loadMagnY: list, loadMagnZ: list
# ---------- cem_load: Python ----------
"""
Defines a new point load object from inputs
    Inputs:
        pointLoad: (point) The vertices that define the point loads in the topological diagram
        loadMagnX: (float) The magnitude of the point load in x-direction [kN]
        loadMagnY: (float) The magnitude of the point load in y-direction [kN]
        loadMagnZ: (float) The magnitude of the point load in z-direction [kN]
    Outputs:
        L: (pointLoadObject) The constructed point load object
    Remarks:
        This generates a new instance of the constructed point load object 
"""



import Rhino


class Load(object):
    def __repr__(self):
        return self.ToString()
        
    def __str__(self):
        return self.ToString()
        
    def ToString(self):
        if pointLoad:
            return "Point Load"
        else:
            return "No external Load"



if pointLoad:
    L = Load()
    L.geom = []
    L.magn = []
    
    if not loadMagnX: loadMagnX.append(0.0)
    if not loadMagnY: loadMagnY.append(0.0)
    if not loadMagnZ: loadMagnZ.append(0.0)
    
    loadMagn = []
    if len(loadMagnX) == len(loadMagnY) == len(loadMagnZ):
        if len(pointLoad) == len(loadMagnX):
            for i in range(len(pointLoad)):
                loadMagn.append( (loadMagnX[i],loadMagnY[i],loadMagnZ[i]) )
            L.geom = pointLoad
            L.magn = loadMagn
        elif len(loadMagnX) == 1:
            for i in range(len(pointLoad)):
                loadMagn.append( (loadMagnX[0],loadMagnY[0],loadMagnZ[0]) )
            L.geom = pointLoad
            L.magn = loadMagn
        else:
            for i in range(len(pointLoad)):
                loadMagn.append( 0,0,0 )
            L.geom = pointLoad
            L.magn = loadMagn
    else:
        for i in range(len(pointLoad)):
            loadMagn.append( 0,0,0 )
        L.geom = pointLoad
        L.magn = loadMagn
# ---------- end cem_load ----------
cem_trail = GhPythonScript(trailEdge=flatten(trailedgetower), trailLen=flatten(number_slider_5))  # -> T; inputs trailEdge: list of Curve, trailLen: list
# ---------- cem_trail: Python ----------
"""
Defines new trail edges from inputs
    Inputs:
        trailEdge: (curves) The curves (segments) that define the trail members in the topological diagram
        trailLen: (float) The lenghts of the trail members [m] (tension-positive, compression-negative)
    Outputs:
        T: (trailObject) The constructed trail object
    Remarks:
        This generates a new instance of a trail object
"""

import Rhino


class Trail(object):
    def __repr__(self):
        return self.ToString()
        
    def __str__(self):
        return self.ToString()
        
    def ToString(self):
        if trailEdge:
            return "Trail Member"



if trailEdge:
    T = Trail()
    T.geom = []
    T.len = []
    
    if trailLen:
        if len(trailEdge) == len(trailLen):
            trailLenC = []
            for i in range(len(trailEdge)):
                trailLenC.append( trailLen[i] )
            T.geom = trailEdge
            T.len = trailLenC
        elif len(trailLen) == 1:
            trailLenC = []
            for i in range(len(trailEdge)):
                trailLenC.append( trailLen[0] )
            T.geom = trailEdge
            T.len = trailLenC
        else:
            trailLenC = []
            for i in range(len(trailEdge)):
                trailLenC.append( 1 )
            T.geom = trailEdge
            T.len = trailLenC
    else:
        trailLenC = []
        for i in range(len(trailEdge)):
            trailLenC.append( 1 )
        T.geom = trailEdge
        T.len = trailLenC
# ---------- end cem_trail ----------
cem_support = GhPythonScript(support=flatten(support))  # -> S; inputs support: list of Point3d
# ---------- cem_support: Python ----------
"""
Defines a new support object from inputs
    Inputs:
        support: (points) The support points in the topological diagram
    Outputs:
        S: (supportObject) The constructed support object 
    Remarks:
        This generates a new instance of the support object
"""


class Support(object):
    def __repr__(self):
        return self.ToString()
        
    def __str__(self):
        return self.ToString()
        
    def ToString(self):
        if support:
            return "Support"


if support:
    S = Support()
    S.geom = support
# ---------- end cem_support ----------
cem_build_topology = PythonScript(T=cem_trail, L=cem_load, D=cem_deviation, S=cem_support)  # -> out, TP; inputs T: list, L: list, D: list, S: list
# ---------- cem_build_topology: Python ----------
"""
Defines a new topological diagram from inputs
    Inputs:
        T: (trailObjects) Trail members in the topological diagram 
        L: (pointLoadObjects) Point Loads in the topological diagram 
        D: (deviationObjects) Deviation members in the topological diagram 
        S: (supportObjects) Supports in the topological diagram
    Outputs:
        TP: (topological diagram) The constructed topological diagram (empty topology on error)
    Remarks:
        This generates a new instance of the topological diagram
"""

__author__    = ['Patrick Ole Ohlbrock','Pierluigi D''Acunto' ]
__copyright__ = 'Copyright 2019 - Chair of Structural Design, ETH Zurich'
__license__   = 'MIT License'
__email__     = 'ohlbrock@arch.ethz.ch'
__version__   = "1.75"

"""
If you use the CEM library in a project, please refer to the GitHub repository: 

@Misc{cem2019,
author = {Ohlbrock, Patrick Ole and D'Acunto, Pierluigi},
title = {{CEM: Combinatorial Equilibrium Modeling}},
year = {2019},
note = {Release 1.75},
url = { http://github.com/OleOhlbrock/CEM },
}

"""




import System.Drawing.Color
import System.Guid
import Rhino
db0_T = 0.001

class topology(object):
    def __repr__(self):
        return self.ToString()
        
    def __str__(self):
        return self.ToString()
        
    def ToString(self):
        if trailMembers and trailMembersID:
            if len(trailMembers) == len(trailMembersID):
                str0_Description = ""
                if hasattr(self, "str1_StructuralBehaviourOut") or hasattr(self, "db1_StructuralBehaviourOut")  and pt1_NodeOut and int2_Trail:
                    str0_Description += "Topological Diagram\n\nvertices: " + str(len(pt1_NodeOut)) + "\ntrail members: " + str(len(int2_Trail)) 
                    if int2_Deviation1:
                        str0_Description += "\ndirect deviation members: " + str(len(int2_Deviation1))
                        if str2_Deviation2:
                            str0_Description += "\nindirect deviation members: " + str(len(str2_Deviation2))
                    return str0_Description
                else:
                    return "Empty topology"
            else:
                return "Empty topology"
        else:
            return "Empty topology"


def ListListToList(xx2_Data):
    xx1_DataOut = []
    for xx1_Data in xx2_Data:
        xx1_DataOut.extend(xx1_Data)
    return xx1_DataOut


TP = topology()


externalForces = []
externalForcesID = []
if L:
    for l in L:
        if l:
            externalForces.extend(l.geom)
            externalForcesID.extend(l.magn)


trailMembers = []
trailMembersID = []
if T:
    for t in T:
        if t:
            trailMembers.extend(t.geom)
            trailMembersID.extend(t.len)


deviationMembers = []
deviationMembersID = []
if D:
    for d in D:
        if d:
            deviationMembers.extend(d.geom)
            deviationMembersID.extend(d.magn)

supports = []
if S:
    for s in S:
        if s:
            supports.extend(s.geom)



if trailMembers and trailMembersID:
    if len(trailMembers) == len(trailMembersID) and len(deviationMembers) == len(deviationMembersID) and len(externalForces) == len(externalForcesID):

        # Create List of Nodes and trailMembers' Connectivity
        pt1_Node = []
        int2_Trail = []
        int2_Deviation = []
        int2_ExtForce = []
        
        pt1_Node.append(trailMembers[0].PointAtStart)
        
        # Nodes and Egdes from trailMembers
        for crv0_Trail in trailMembers:
            int1_Trail = []
            pt0_Start = crv0_Trail.PointAtStart
            bl0_Check = False
            for i in xrange(len(pt1_Node)):
                if abs(pt0_Start.X - pt1_Node[i].X) < db0_T and abs(pt0_Start.Y - pt1_Node[i].Y) < db0_T and abs(pt0_Start.Z - pt1_Node[i].Z) < db0_T:
                    int1_Trail.append(i)
                    bl0_Check = True
                    break
            if bl0_Check == False:
                pt1_Node.append(pt0_Start)
                int1_Trail.append(len(pt1_Node)-1)
            pt0_End = crv0_Trail.PointAtEnd
            bl0_Check = False
            for i in xrange(len(pt1_Node)):
                if abs(pt0_End.X - pt1_Node[i].X) < db0_T and abs(pt0_End.Y - pt1_Node[i].Y) < db0_T and abs(pt0_End.Z - pt1_Node[i].Z) < db0_T:
                    int1_Trail.append(i)
                    bl0_Check = True
                    break
            if bl0_Check == False:
                pt1_Node.append(pt0_End)
                int1_Trail.append(len(pt1_Node)-1)
            int2_Trail.append(int1_Trail)
        

        # Deviation
        crv1_DeviationClean = []
        id1_DeviationClean = []
        for k in xrange(len(deviationMembers)):
            pt0_StartDeviation = deviationMembers[k].PointAtStart
            pt0_EndDeviation = deviationMembers[k].PointAtEnd
            for i in xrange(len(pt1_Node)):
                if abs(pt0_StartDeviation.X - pt1_Node[i].X) < db0_T and abs(pt0_StartDeviation.Y - pt1_Node[i].Y) < db0_T and abs(pt0_StartDeviation.Z - pt1_Node[i].Z) < db0_T:
                    for j in xrange(len(pt1_Node)):
                        if abs(pt0_EndDeviation.X - pt1_Node[j].X) < db0_T and abs(pt0_EndDeviation.Y - pt1_Node[j].Y) < db0_T and abs(pt0_EndDeviation.Z - pt1_Node[j].Z) < db0_T:
                            crv1_DeviationClean.append(deviationMembers[k])
                            id1_DeviationClean.append(deviationMembersID[k])
                            int1_Deviation = []
                            int1_Deviation.append(i)
                            int1_Deviation.append(j)
                            int2_Deviation.append(int1_Deviation)
                            break
                    break
        deviationMembers = crv1_DeviationClean
        deviationMembersID = id1_DeviationClean
        
        # External Force
        pt1_ExtForceClean = []
        External_Forces_IDClean = []
        for k in xrange(len(externalForces)):
            for i in xrange(len(pt1_Node)):
                int1_ExtForce = []
                if abs(externalForces[k].X - pt1_Node[i].X) < db0_T and abs(externalForces[k].Y - pt1_Node[i].Y) < db0_T and abs(externalForces[k].Z - pt1_Node[i].Z) < db0_T:
                    pt1_ExtForceClean.append(externalForces[k])
                    External_Forces_IDClean.append(externalForcesID[k])
                    int1_ExtForce.append(i)
                    int2_ExtForce.append(int1_ExtForce)
                    break
        
        externalForces = pt1_ExtForceClean
        externalForcesID = External_Forces_IDClean
        
        
        # Extract Attributes External Forces
        st2_externalForcesID = []
        for i in range(len(externalForcesID)):
            st1_externalForcesID = []
            for j in range(len(externalForcesID[i])):
                st1_externalForcesID.append(str(externalForcesID[i][j]))
            st2_externalForcesID.append(st1_externalForcesID)
        str2_ExtForceAtt = st2_externalForcesID

        # Extract Attributes trailMembers
        str1_TrailAtt = [str(x) for x in trailMembersID]

        # Extract Attributes Deviation
        str1_DeviationAtt = [str(x) for x in deviationMembersID]
        
        
        # Create Dictionary of trailMembers' Ends
        dc2_TrailEnds = {}
        for i in xrange(len(int2_Trail)):
            dc2_TrailEnds[str(i)] = [str(x) for x in int2_Trail[i]]
        
        # Create Dictionary of trailMembers' Attributes
        dc1_TrailAtt = {}
        for i in xrange(len(str1_TrailAtt)):
            dc1_TrailAtt[str(i)] = str1_TrailAtt[i]
        
        
        # Create Dictionary of External Forces' End
        dc1_ExtForceEnds = {}
        for i in xrange(len(int2_ExtForce)):
            dc1_ExtForceEnds[str(i)] = str(int2_ExtForce[i][0])
        
        
        # Create Dictionary of External Forces' Attributes
        dc2_ExtForceAtt = {}
        for i in xrange(len(str2_ExtForceAtt)):
            dc2_ExtForceAtt[str(i)] = [x for x in str2_ExtForceAtt[i]]

        
        # Create Lists of Node-Node Connectivity from trailMembers
        int2_Node = []
        for pt0_Node in pt1_Node:
            int1_Node = []
            int2_Node.append(int1_Node)
        for int1_Trail in int2_Trail:
            int2_Node[int1_Trail[0]].append(int1_Trail[1])
            int2_Node[int1_Trail[1]].append(int1_Trail[0])
        
        
        # Create Lists of Deviations' Ends and Attributes
        str2_Deviation = []
        for i in xrange(len(str1_DeviationAtt)):
            str2_Deviation.append( [str(item) for item in int2_Deviation[i] ] )
            str2_Deviation[i].extend([str1_DeviationAtt[i]])
        
        # Convert Trail Input into Polylines
        ln1_Trail = []
        for crv0_Trail in trailMembers:
            if crv0_Trail is Rhino.Geometry.Line:
                ln1_Trail.append(crv0_Trail)
            else:
                ln1_Trail.append(Rhino.Geometry.Line(crv0_Trail.PointAtStart, crv0_Trail.PointAtEnd))
        
        trailMembers = []
        for ln0_Trail in ln1_Trail:
            trailMembers.append(ln0_Trail.ToNurbsCurve())
        
        plc1_Trail = Rhino.Geometry.Curve.JoinCurves(trailMembers)
        
        pln1_Trail = []
        for plc0_Trail in plc1_Trail:
            pln1_Trail.append(plc0_Trail.TryGetPolyline()[1])
        
        
        # Check supports
        pt1_SupportClean = []
        for j in xrange(len(pln1_Trail)):
            if supports:
                pt1_SupportClean.append(pln1_Trail[j][len(pln1_Trail[j])-1])
                for i in xrange(len(supports)):
                    if abs(pln1_Trail[j][0].X - supports[i].X) < db0_T and abs(pln1_Trail[j][0].Y - supports[i].Y) < db0_T and abs(pln1_Trail[j][0].Z - supports[i].Z) < db0_T:
                        pt1_SupportClean[j] = pln1_Trail[j][0]
                        pln1_Trail[j].Reverse()
            else:
                pt1_SupportClean.append(pln1_Trail[j][len(pln1_Trail[j])-1])
        supports = pt1_SupportClean
        
        
        # Find Node Indexes of supports
        int1_Support = []
        for pt0_Support in supports:
            for i in xrange(len(pt1_Node)):
                if abs(pt0_Support.X - pt1_Node[i].X) < db0_T and abs(pt0_Support.Y - pt1_Node[i].Y) < db0_T and abs(pt0_Support.Z - pt1_Node[i].Z) < db0_T:
                    int1_Support.append(i)
                    break
        
        # Create Graph (Dictionary of Node-Node Connectivity from trailMembers)
        dc2_Node = {}
        for i in xrange(len(int2_Node)):
            dc2_Node[str(i)] = [str(x) for x in int2_Node[i]]
        
        int2_TrailPoly = []
        for pln0_Trail in pln1_Trail:
            int1_TrailPoly = []
            for i in xrange(len(pln0_Trail)):
                for k in xrange(len(pt1_Node)):
                    if abs(pln0_Trail[i].X - pt1_Node[k].X) < db0_T and abs(pln0_Trail[i].Y - pt1_Node[k].Y) < db0_T and abs(pln0_Trail[i].Z - pt1_Node[k].Z) < db0_T:
                        int1_TrailPoly.append(k)
                        break
            int2_TrailPoly.append(list(reversed(int1_TrailPoly)))
        
        dc2_ShortPath = {}

        for i in xrange(len(pt1_Node)):
            for int1_TrailPoly in int2_TrailPoly:
                if i in int1_TrailPoly:
                    str1_ShortPath = ["S"]
                    str1_ShortPath.extend(map(str, int1_TrailPoly[:int1_TrailPoly.index(i)+1]))
                    dc2_ShortPath[str(i)] = str1_ShortPath
                    break
        
        dc1_ShortPathDist = {}
        dc2_ShortPathDistGrade = {}
        
        for i in xrange(len(pt1_Node)):
            for pln0_Trail in pln1_Trail:
                for j in xrange(len(pln0_Trail)):
                    if abs(pln0_Trail[j].X - pt1_Node[i].X) < db0_T and abs(pln0_Trail[j].Y - pt1_Node[i].Y) < db0_T and abs(pln0_Trail[j].Z - pt1_Node[i].Z) < db0_T:
                        dc1_ShortPathDist[str(i)] = len(pln0_Trail) - j
                        break
        

        # Define Sequences
        for key in dc1_ShortPathDist:
            if dc1_ShortPathDist[key] not in dc2_ShortPathDistGrade:
                dc2_ShortPathDistGrade[dc1_ShortPathDist[key]] = [key]
            else:
                dc2_ShortPathDistGrade[dc1_ShortPathDist[key]].extend([key])
        
        
        # Separate Deviation1 (direct) and Deviation2 (indirect-bracing)
        
        dc2_Deviation1Ends = {}
        dc2_Deviation2Ends = {}
        
        dc1_Deviation1Att = {}
        dc1_Deviation2Att = {}
        
        int2_Deviation1 = []
        str2_Deviation2 = []
        
        crv1_Deviation1 = []
        crv1_Deviation2 = []
        
        int1_Deviation1ID = []
        int1_Deviation2ID = []
        
        j = 0
        k = 0
        
        
        for i in xrange(len(str2_Deviation)):
            if dc1_ShortPathDist[ str(str2_Deviation[i][0]) ] == dc1_ShortPathDist[ str(str2_Deviation[i][1]) ]:
                dc2_Deviation1Ends[str(j)] = [str(str2_Deviation[i][0]),str(str2_Deviation[i][1])]
                dc1_Deviation1Att[str(j)] = str(str2_Deviation[i][2])
                int2_Deviation1.append([int(str2_Deviation[i][0]),int(str2_Deviation[i][1])])
                crv1_Deviation1.append(deviationMembers[i])
                int1_Deviation1ID.append(i)
                print j
                j += 1
            else:
                dc2_Deviation2Ends[str(k)] = [str(str2_Deviation[i][0]),str(str2_Deviation[i][1])]
                dc1_Deviation2Att[str(k)] = str(str2_Deviation[i][2])
                str2_Deviation2.append(str2_Deviation[i])
                crv1_Deviation2.append(deviationMembers[i])
                int1_Deviation2ID.append(i)
                k += 1
        
        print dc2_Deviation1Ends
        print int1_Deviation1ID
        print int1_Deviation2ID
        
        # Create Dictionary of Trail and Deviation 1 for Structural Matrix
        dc2_EdgeEnds = {}
        dc2_TrailEndsOut = dc2_TrailEnds.copy()
        dc2_Deviation1EndsOut = {}
        
        for key in dc2_TrailEnds:
            dc2_EdgeEnds[str(int(key))] = dc2_TrailEnds[key]
        for key in dc2_Deviation1Ends:
            dc2_EdgeEnds[str(int(key)+len(dc2_TrailEnds))] = dc2_Deviation1Ends[key]
            dc2_Deviation1EndsOut[str(int(key)+len(dc2_TrailEnds))] = dc2_Deviation1Ends[key]
            
        dc1_EdgeAtt = {}
        for key in dc1_TrailAtt:
            dc1_EdgeAtt[str(int(key))] = dc1_TrailAtt[key]
        for key in dc1_Deviation1Att:
            dc1_EdgeAtt[str(int(key)+len(dc1_TrailAtt))] = dc1_Deviation1Att[key]
        
        # Create Dictionary of Trail and Deviation 1 and 2 for Visualization
        dc1_Edge = {}
        for key in dc1_TrailAtt:
            dc1_Edge[str(int(key))] = dc1_TrailAtt[key]
        for key in dc1_Deviation1Att:
            dc1_Edge[str(int(key)+len(dc1_TrailAtt))] = dc1_Deviation1Att[key]
        for key in dc1_Deviation2Att:
            dc1_Edge[str(int(key)+len(dc1_TrailAtt)+len(dc1_Deviation1Att))] = dc1_Deviation2Att[key]
        
        ## Visualization
        
        # Nodes
        pt1_NodeOut = pt1_Node
        pt1_TargetOut = pt1_NodeOut
        str1_NodeOut = [str(i) + " (" + str(dc1_ShortPathDist[str(i)]) + ")" for i in xrange(len(pt1_Node))]
        str1_TargetOut = [str(i) for i in xrange(len(pt1_Node))]
        
        # Edges
        crv1_Edge = []
        for crv0_Trail in trailMembers: crv1_Edge.append(crv0_Trail)
        for crv0_Deviation1 in crv1_Deviation1: crv1_Edge.append(crv0_Deviation1)
        for crv0_Deviation2 in crv1_Deviation2: crv1_Edge.append(crv0_Deviation2)
        
        crv1_EdgeOut = crv1_Edge
        pt1_EdgeOut = [crv0_Edge.PointAtNormalizedLength(0.6) for crv0_Edge in crv1_EdgeOut]
        str1_EdgeOut = [str(i) + " (" + dc1_Edge[str(i)] + ")" for i in xrange(len(crv1_EdgeOut))]

        # Update Lists of Node-Node Connectivity from Deviation 1
        for int1_DevTemp in int2_Deviation1:
            int2_Node[int1_DevTemp[0]].append(int1_DevTemp[1])
            int2_Node[int1_DevTemp[1]].append(int1_DevTemp[0])
        
        
        # Create Graph (Dictionary of Node-Node Connectivity from trailMembers)
        for i in xrange(len(int2_Node)):
            dc2_Node[str(i)] = [str(x) for x in int2_Node[i]]
        
        
        ## Create Dictionaries for Structural Matrix
        dc1_NodeTrailOut = {}
        dc1_NodeTrailIn = {}
        dc2_NodeDeviation = {}
        dc1_NodeExtForce = {}
        dc1_NodeExtForceAtt = {}
        int0_NodeTrailIn = {}

        
        # Trail In and Out
        for key in dc2_ShortPath:
            dc1_NodeTrailOut[key] = dc2_ShortPath[key][len(dc2_ShortPath[key])-2]
        
        int0_ShortPathDistGradeMax = max(dc2_ShortPathDistGrade)
        
        for key in dc1_NodeTrailOut:
            if dc1_NodeTrailOut[key] == "S": dc1_NodeTrailOut[key] = dc1_NodeTrailOut[key] + key
            dc1_NodeTrailIn[dc1_NodeTrailOut[key]] = key

        for key in dc1_NodeTrailOut:
            if key not in dc1_NodeTrailIn:
                str0_Key = "L" + key
                for i in range(int0_ShortPathDistGradeMax - dc1_ShortPathDist[key] + 1):
                    dc1_NodeTrailIn[str0_Key[1:]] = str0_Key
                    str0_Key = "L" + str0_Key

        
        for key in dc1_NodeTrailIn:
            if "L" + key not in dc1_NodeTrailOut:
                dc1_NodeTrailOut[dc1_NodeTrailIn[key]] = key
        
        # Deviation
        for key in dc2_Node:
            str1_v = []
            for v in dc2_Node[key]:
                if v != dc1_NodeTrailOut[key] and v != dc1_NodeTrailIn[key]:
                    str1_v.append(v)
            dc2_NodeDeviation[key] = str1_v
        
        # External Forces
        for key in dc1_ExtForceEnds:
            if dc1_ExtForceEnds[key] not in dc1_NodeExtForce:
                dc1_NodeExtForce[dc1_ExtForceEnds[key]] = [key]
            else:
                dc1_NodeExtForce[dc1_ExtForceEnds[key]].append(key)
        
        for key in dc1_NodeExtForce:
            for v in dc1_NodeExtForce[key]:
                if dc1_ExtForceEnds[v] not in dc1_NodeExtForceAtt:
                    dc1_NodeExtForceAtt[key] = [item for item in dc2_ExtForceAtt[v]]
                else:
                    xx1_NodeExtForceAtt = dc1_NodeExtForceAtt[dc1_ExtForceEnds[v]]
                    for i in xrange(len(xx1_NodeExtForceAtt)):
                        try:
                            xx1_NodeExtForceAtt[i] = float(xx1_NodeExtForceAtt[i])
                        except:
                            xx1_NodeExtForceAtt[i] = -1.0
                            
                            
                    try:
                        dc2_ExtForceAtt[v][0] = float(dc2_ExtForceAtt[v][0])
                    except:
                        dc2_ExtForceAtt[v][0] = -1.0
                    try:
                        dc2_ExtForceAtt[v][1] = float(dc2_ExtForceAtt[v][1])
                    except:
                        dc2_ExtForceAtt[v][1] = -1.0
                    try:
                        dc2_ExtForceAtt[v][2] = float(dc2_ExtForceAtt[v][2])
                    except:
                        dc2_ExtForceAtt[v][2] = -1.0
                    dc1_NodeExtForceAtt[key][0] += float(dc2_ExtForceAtt[v][0])
                    dc1_NodeExtForceAtt[key][1] += float(dc2_ExtForceAtt[v][1])
                    dc1_NodeExtForceAtt[key][2] += float(dc2_ExtForceAtt[v][2])
        
        
        ## Create Structural Matrix According to Weight
        
        # Initialize Matrix with Indices
        str2_StructuralMatrix = []
        str1_NodeOrderMatrix = []
        str2_NodeOrderMatrix = []
        
        str1_NodeOrder = dc2_ShortPathDistGrade[1]

        for i in sorted(xrange(1,len(dc2_ShortPathDistGrade)+1)):
            str1_NodeOrderUp = []
            str2_NodeOrderMatrix.append(str1_NodeOrder)
            for str0_NodeOrder in str1_NodeOrder:
                str1_NodeOrderMatrix.append(str0_NodeOrder)
                if str0_NodeOrder[0] != "L":
                    str2_StructuralMatrix.append(["0"]*(3+len(str1_NodeOrder)+1))
                    str1_NodeOrderUp.append(dc1_NodeTrailIn[str0_NodeOrder])
                    
                else:
                    str2_StructuralMatrix.append(["0"]*(3+len(str1_NodeOrder)+1))
                    str1_NodeOrderUp.append("L" + str0_NodeOrder)
                    dc1_NodeTrailIn[str0_NodeOrder] = str0_NodeOrder[1:]
                    dc2_EdgeEnds[str0_NodeOrder.replace("L","E")] = [str0_NodeOrder[1:], str0_NodeOrder]
                    dc2_TrailEndsOut[str0_NodeOrder.replace("L","E")] = [str0_NodeOrder[1:], str0_NodeOrder]
            str1_NodeOrder = str1_NodeOrderUp
            
        int0_NodeOrderMatrix = len(str2_NodeOrderMatrix[0])

        # Add Attribute External Forces
        for key in dc1_NodeExtForce:
            int0_NodeIndex = str1_NodeOrderMatrix.index(key)
            str2_StructuralMatrix[int0_NodeIndex][0:3] = [str(item) for item in dc1_NodeExtForceAtt[key]]
        
        # Add Attributes Auxiliary Trails
        for key in dc2_EdgeEnds: 
            if key[0] == "E": dc1_EdgeAtt[key] = "0.0"
        
        # Add Attribute Trail Out
        for key in dc2_EdgeEnds:
            if dc2_EdgeEnds[key][0] in dc1_NodeTrailOut and dc2_EdgeEnds[key][1] == dc1_NodeTrailOut[dc2_EdgeEnds[key][0]]:
                int0_NodeIndex = str1_NodeOrderMatrix.index(dc2_EdgeEnds[key][0])
                str2_StructuralMatrix[int0_NodeIndex][len(str2_StructuralMatrix[int0_NodeIndex])-1] = dc1_EdgeAtt[key]
            elif dc2_EdgeEnds[key][1] in dc1_NodeTrailOut and dc2_EdgeEnds[key][0] == dc1_NodeTrailOut[dc2_EdgeEnds[key][1]]:
                int0_NodeIndex = str1_NodeOrderMatrix.index(dc2_EdgeEnds[key][1])
                str2_StructuralMatrix[int0_NodeIndex][len(str2_StructuralMatrix[int0_NodeIndex])-1] = dc1_EdgeAtt[key]
        
        # Add Attribute Deviation
        for key in dc2_EdgeEnds:
            if dc2_EdgeEnds[key][0] in dc2_NodeDeviation and dc2_EdgeEnds[key][1] in dc2_NodeDeviation[dc2_EdgeEnds[key][0]]:
                int0_NodeIndex = str1_NodeOrderMatrix.index(dc2_EdgeEnds[key][0])
                int0_NodeIndexTo = str1_NodeOrderMatrix.index(dc2_EdgeEnds[key][1])
                int0_NodeIndexRaw = (int0_NodeIndexTo) % int0_NodeOrderMatrix
                str2_StructuralMatrix[int0_NodeIndex][3 + int0_NodeIndexRaw] = dc1_EdgeAtt[key]
            if dc2_EdgeEnds[key][1] in dc2_NodeDeviation and dc2_EdgeEnds[key][0] in dc2_NodeDeviation[dc2_EdgeEnds[key][1]]:
                int0_NodeIndex = str1_NodeOrderMatrix.index(dc2_EdgeEnds[key][1])
                int0_NodeIndexTo = str1_NodeOrderMatrix.index(dc2_EdgeEnds[key][0])
                int0_NodeIndexRaw = (int0_NodeIndexTo) % int0_NodeOrderMatrix
                str2_StructuralMatrix[int0_NodeIndex][3 + int0_NodeIndexRaw] = dc1_EdgeAtt[key]
        
        # Order Matrix
        str2_StructuralMatrixOrder = []
        int1_StructuralMatrixOrder = []
        str2_NodeOrderMatrixReversed = []
        
        for i in reversed(xrange(1,len(str2_NodeOrderMatrix)+1)):
            for j in xrange(int0_NodeOrderMatrix):
                int0_Index = int0_NodeOrderMatrix*(i-1)+j
                if i != len(str2_NodeOrderMatrix):
                    int1_StructuralMatrixOrder.append(str2_NodeOrderMatrix[i-1][j])
                str2_StructuralMatrixOrder.append(str2_StructuralMatrix[int0_NodeOrderMatrix*(i-1)+j])
        
        for i in reversed(xrange(1,len(str2_NodeOrderMatrix)+1)):
            str1_NodeOrderMatrixReversed = []
            for j in xrange(int0_NodeOrderMatrix):
                str1_NodeOrderMatrixReversed.append(str2_NodeOrderMatrix[i-1][j])
            str2_NodeOrderMatrixReversed.append(str1_NodeOrderMatrixReversed)

        
        # Substitute Node Index with Matrix Index in Deviation2
        str1_Deviation2 = ListListToList(str2_Deviation2)
        str1_NodeOrder = ListListToList(str2_NodeOrderMatrixReversed)
        
        str1_NodeOrderOut = str1_NodeOrder[:]
        
        # Edge-Node List
        dc2_EdgeEndsComplete = {}
        dc2_EdgeEndsComplete = dict(dc2_EdgeEnds)
        dc2_Deviation2EndsOut = {}
        
        
        int0_EdgeEndsLen = len([k for k in dc2_EdgeEndsComplete if not k.startswith('E')])
        
        for i in range(0,len(str1_Deviation2),3):
            dc2_EdgeEndsComplete[str( int(int0_EdgeEndsLen+i/3) )] = [str1_Deviation2[i],str1_Deviation2[i+1]]
            dc2_Deviation2EndsOut[str( int(int0_EdgeEndsLen+i/3) )] = [str1_Deviation2[i],str1_Deviation2[i+1]]
                
        for i in xrange(len(str1_Deviation2)):
            if (i+1) % 3 != 0:
                str1_Deviation2[i] = str1_NodeOrder.index(str(str1_Deviation2[i]))
        
        
        
        ## Output
        str1_DeviationIndirectOut = str1_Deviation2
        str1_StructuralBehaviourOut = ListListToList(str2_StructuralMatrixOrder)
        
        #### AUTOMATIC GEOMETRIC INPUT FOR FORM DIAGRAM
        
        # str1_NodeOrderOut from Graph with "L" where leaf (as List)
        # str1_NodeOrderC = Clean Node Order without L but duplicated node numbers where needed
        # pt1_NodeOut = geometric locations from vertices in graph
        
        # Amount of layers
        N_layers = len(str1_NodeOrder)/len(supports)
        
        # Create List of Origin Nodes with Indexes
        str1_OriginNodeOut = [str0_OriginNodeOut.replace("L","") for str0_OriginNodeOut in str1_NodeOrder[:len(supports)]]
        pt1_OriginNodeOut = []
        for str0_OriginNodeOut in str1_OriginNodeOut:
            pt1_OriginNodeOut.append(pt1_Node[int(str0_OriginNodeOut)])

        str1_ConstraintPlane = []
        pl1_ConstraintPlane = []

        for key in dc2_TrailEnds:
            
            str0_0 = dc2_TrailEnds[key][0]
            str0_1 = dc2_TrailEnds[key][1]
            int0_0 = dc1_ShortPathDist[str0_0]
            int0_1 = dc1_ShortPathDist[str0_1]
            
            str1_ConstraintPlane.append(str0_0)
            pt0_Start = pt1_NodeOut[int(str0_0)]
            pt0_End = pt1_NodeOut[int(str0_1)]
            
            if int0_0 > int0_1:
                str1_ConstraintPlane[len(str1_ConstraintPlane)-1] = str0_1
                pt0_Start = pt1_NodeOut[int(str0_1)]
                pt0_End = pt1_NodeOut[int(str0_0)]
                
            vc0_Normal = Rhino.Geometry.Vector3d(pt0_End-pt0_Start)
            pl0_Plane = Rhino.Geometry.Plane(pt0_Start,vc0_Normal)
            pl1_ConstraintPlane.append(pl0_Plane)
            

        
        str1_ConstraintPlaneOut = str1_ConstraintPlane
        pl1_ConstraintPlaneOut = pl1_ConstraintPlane

        TP.str1_StructuralBehaviourOut = str1_StructuralBehaviourOut
        TP.str1_DeviationIndirectOut = str1_DeviationIndirectOut
        TP.pt1_NodeOut = pt1_NodeOut
        TP.str1_NodeOut = str1_NodeOut
        TP.crv1_EdgeOut = crv1_EdgeOut
        TP.pt1_EdgeOut = pt1_EdgeOut
        TP.str1_EdgeOut = str1_EdgeOut
        TP.dc2_EdgeEndsCompleteOut = dc2_EdgeEndsComplete
        TP.dc2_TrailEndsOut = dc2_TrailEndsOut
        TP.dc2_Deviation1EndsOut = dc2_Deviation1EndsOut
        TP.dc2_Deviation2EndsOut = dc2_Deviation2EndsOut
        TP.int1_Deviation1ID = int1_Deviation1ID
        TP.int1_Deviation2ID = int1_Deviation2ID
        TP.str1_NodeOrderOut = str1_NodeOrderOut
        TP.str1_ConstraintPlaneOut = str1_ConstraintPlaneOut
        TP.pl1_ConstraintPlaneOut = pl1_ConstraintPlaneOut
        TP.str1_OriginNodeOut = str1_OriginNodeOut
        TP.pt1_OriginNodeOut = pt1_OriginNodeOut


def StringToFloat(val):
    try:
        return float(val)
    except (ValueError, TypeError):
        return 1.0

if TP and hasattr(TP, "str1_StructuralBehaviourOut"):
    str1_StructuralBehaviour = TP.str1_StructuralBehaviourOut[:]
    str1_DeviationIndirect = TP.str1_DeviationIndirectOut[:]
    db1_StructuralBehaviour = []
    db1_DeviationIndirect = []
        
    for i in xrange(len(str1_StructuralBehaviour)):
        db1_StructuralBehaviour.append(StringToFloat(str1_StructuralBehaviour[i]))
    
    for i in xrange(len(str1_DeviationIndirect)):
        db1_DeviationIndirect.append(StringToFloat(str1_DeviationIndirect[i]))

    del TP.str1_StructuralBehaviourOut
    del TP.str1_DeviationIndirectOut
    
    TP.db1_StructuralBehaviourOut = db1_StructuralBehaviour
    TP.db1_DeviationIndirectOut = db1_DeviationIndirect
# ---------- end cem_build_topology ----------
panel = Panel(cem_build_topology.TP)

# ----
cem_extract_topology = PythonNoHint(TP=cem_build_topology.TP)  # -> nodes, nodesID, edges, edgesID, constraintPlane, constraintPlaneID, originNode, originNodeID
# ---------- cem_extract_topology: Python ----------
"""
Retrieves automatically geometric properties from the topological diagram
    Inputs:
        TP: (topological diagram) The topological diagram used for the calculation of the structural model
    Outputs:
        nodes: (point 3D) The vertices describing the topological diagram
        nodesID: (integer) The corresponding node number
        edges: (edge midpoint) The edges describing the topological diagram
        edgesID: (integer) The corresponding edge number
        constraintPlane: (plane) The planes which are based on the trails normal vectors of the toplogical diagram 
        constraintPlaneID: (integer) The indices of these planes
        originNode: (point 3D) The origin points from the topological diagram
        originNodeID: (integer) The indices of these points
    Remarks:
        This extract geometric information from TP
"""




if TP and hasattr(TP, "str1_NodeOut") and hasattr(TP, "pt1_NodeOut"):
    nodes = TP.pt1_NodeOut
    nodesID = TP.str1_NodeOut


if TP and hasattr(TP, "str1_NodeOut") and hasattr(TP, "pt1_NodeOut"):
    edges = TP.pt1_EdgeOut
    edgesID = TP.str1_EdgeOut


if TP and hasattr(TP, "pl1_ConstraintPlaneOut") and hasattr(TP, "str1_ConstraintPlaneOut"):
    constraintPlane = TP.pl1_ConstraintPlaneOut
    constraintPlaneID = TP.str1_ConstraintPlaneOut

if TP and hasattr(TP, "pt1_OriginNodeOut"):
    originNode = TP.pt1_OriginNodeOut
    originNodeID = TP.str1_OriginNodeOut
# ---------- end cem_extract_topology ----------

# ---- group: CEM_Calculate_Structure
self_weight = BooleanToggle(False)
list = ValueList({"LD_AUGLAG", "LD_LBFGS", "LD_SLSQP", "LD_TNEWTON", "LN_BOBYQA", "LN_COBYLA", "LN_SBPLX", "GD_MLSL", "GN_MLSL", "GN_ISRES"}, selected="LN_BOBYQA")
yieldstress_kn_m2 = Slider(500000, range=50..1000000)
targetnodes = Point()
targetnodeid = Integer(0)
targetvector = Vector()
targetvectorid = Integer()
targetvectorcoeffdir = Slider(0, range=0..10000)
bounddevid = Integer()
# CEM - Calculate Structure
originnodes = Point(cem_extract_topology.originNode)
specific_weight_kn_m3 = Slider(73.5, range=5..500)
targetvectorcoeffmag = Slider(0, range=0..10000)
boundoriginnodeid = Integer(10)
boundscoefficientoriginnodex = Slider(0, range=0..1000)
boundtrailid = Integer()
cem_bound_origin_node = GhPythonScript(
    boundOriginNodeID=flatten(boundoriginnodeid),
    boundUpOriginNodeX=flatten(boundscoefficientoriginnodex),
    boundLowOriginNodeX=flatten(boundscoefficientoriginnodex),
    boundUpOriginNodeY=flatten(boundscoefficientoriginnodex),
    boundLowOriginNodeY=flatten(boundscoefficientoriginnodex))  # -> BO; inputs boundOriginNodeID: list of Int32, boundUpOriginNodeX: list, boundLowOriginNodeX: list, boundUpOriginNodeY: list, boundLowOriginNodeY: list, boundUpOriginNodeZ: list, boundLowOriginNodeZ: list
# ---------- cem_bound_origin_node: Python ----------
"""
Assign bounds to origin nodes
    Inputs:
        boundOriginNodeID: (integer) The origin nodes ID that are allowed to move
        boundUpOriginNodeX: (float) The upper bound distance in X-direction [m]
        boundLowOriginNodeX: (float) The lower bound distance in X-direction [m]
        boundUpOriginNodeY: (float) The upper bound distance in Y-direction [m]
        boundLowOriginNodeY: (float) The lower bound distance in Y-direction [m]
        boundUpOriginNodeZ: (float) The upper bound distance in Z-direction [m]
        boundLowOriginNodeZ: (float) The lower bound distance in Z-direction [m]
    Outputs:
        BO: (Bounds Origin Nodes) The bounds for the origin nodes.
    Remarks:
        This generates a new instance of bounds for the origin nodes for the optimization
"""


import Rhino


class BoundOriginNode(object):
    def __repr__(self):
        return self.ToString()
        
    def __str__(self):
        return self.ToString()
        
    def ToString(self):
        return "Bound Origin Nodes"


BO = BoundOriginNode()
BO.ID = []
BO.UpX = []
BO.LowX = []
BO.UpY = []
BO.LowY = []
BO.UpZ = []
BO.LowZ = []

if boundOriginNodeID:
    if len(boundOriginNodeID) == len(boundUpOriginNodeX) and len(boundOriginNodeID) == len(boundLowOriginNodeX):
        BO.ID = boundOriginNodeID
        BO.UpX = [abs(boundUpOriginNodeX_i) for boundUpOriginNodeX_i in boundUpOriginNodeX]
        BO.LowX = [-abs(boundLowOriginNodeX_i) for boundLowOriginNodeX_i in boundLowOriginNodeX]
    elif len(boundUpOriginNodeX) == 1 and len(boundLowOriginNodeX) == 1:
        boundUpOriginNodeXC = []
        for i in range(len(boundOriginNodeID)):
            boundUpOriginNodeXC.append(abs(boundUpOriginNodeX[0]))
        boundLowOriginNodeXC = []
        for i in range(len(boundOriginNodeID)):
            boundLowOriginNodeXC.append(-abs(boundLowOriginNodeX[0]))
        BO.ID = boundOriginNodeID
        BO.UpX = boundUpOriginNodeXC
        BO.LowX = boundLowOriginNodeXC
    else:
        boundUpOriginNodeXC = []
        for i in range(len(boundOriginNodeID)):
            boundUpOriginNodeXC.append(0.0)
        boundLowOriginNodeXC = []
        for i in range(len(boundOriginNodeID)):
            boundLowOriginNodeXC.append(0.0)
        BO.ID = boundOriginNodeID
        BO.UpX = boundUpOriginNodeXC
        BO.LowX = boundLowOriginNodeXC

    if len(boundOriginNodeID) == len(boundUpOriginNodeY) and len(boundOriginNodeID) == len(boundLowOriginNodeY):
        BO.ID = boundOriginNodeID
        BO.UpY = [abs(boundUpOriginNodeY_i) for boundUpOriginNodeY_i in boundUpOriginNodeY]
        BO.LowY = [-abs(boundLowOriginNodeY_i) for boundLowOriginNodeY_i in boundLowOriginNodeY]
    elif len(boundUpOriginNodeY) == 1 and len(boundLowOriginNodeY) == 1:
        boundUpOriginNodeYC = []
        for i in range(len(boundOriginNodeID)):
            boundUpOriginNodeYC.append(abs(boundUpOriginNodeY[0]))
        boundLowOriginNodeYC = []
        for i in range(len(boundOriginNodeID)):
            boundLowOriginNodeYC.append(-abs(boundLowOriginNodeY[0]))
        BO.ID = boundOriginNodeID
        BO.UpY = boundUpOriginNodeYC
        BO.LowY = boundLowOriginNodeYC
    else:
        boundUpOriginNodeYC = []
        for i in range(len(boundOriginNodeID)):
            boundUpOriginNodeYC.append(0.0)
        boundLowOriginNodeYC = []
        for i in range(len(boundOriginNodeID)):
            boundLowOriginNodeYC.append(0.0)
        BO.ID = boundOriginNodeID
        BO.UpY = boundUpOriginNodeYC
        BO.LowY = boundLowOriginNodeYC

    if len(boundOriginNodeID) == len(boundUpOriginNodeZ) and len(boundOriginNodeID) == len(boundLowOriginNodeZ):
        BO.ID = boundOriginNodeID
        BO.UpZ = [abs(boundUpOriginNodeZ_i) for boundUpOriginNodeZ_i in boundUpOriginNodeZ]
        BO.LowZ = [-abs(boundLowOriginNodeZ_i) for boundLowOriginNodeZ_i in boundLowOriginNodeZ]
    elif len(boundUpOriginNodeZ) == 1 and len(boundLowOriginNodeZ) == 1:
        boundUpOriginNodeZC = []
        for i in range(len(boundOriginNodeID)):
            boundUpOriginNodeZC.append(abs(boundUpOriginNodeZ[0]))
        boundLowOriginNodeZC = []
        for i in range(len(boundOriginNodeID)):
            boundLowOriginNodeZC.append(-abs(boundLowOriginNodeZ[0]))
        BO.ID = boundOriginNodeID
        BO.UpZ = boundUpOriginNodeZC
        BO.LowZ = boundLowOriginNodeZC
    else:
        boundUpOriginNodeZC = []
        for i in range(len(boundOriginNodeID)):
            boundUpOriginNodeZC.append(0.0)
        boundLowOriginNodeZC = []
        for i in range(len(boundOriginNodeID)):
            boundLowOriginNodeZC.append(0.0)
        BO.ID = boundOriginNodeID
        BO.UpZ = boundUpOriginNodeZC
        BO.LowZ = boundLowOriginNodeZC
        
else:
    boundUpOriginNodeXC = []
    for i in range(len(boundOriginNodeID)):
        boundUpOriginNodeXC.append(0.0)
    boundLowOriginNodeXC = []
    for i in range(len(boundOriginNodeID)):
        boundLowOriginNodeXC.append(0.0)
    boundUpOriginNodeYC = []
    for i in range(len(boundOriginNodeID)):
        boundUpOriginNodeYC.append(0.0)
    boundLowOriginNodeYC = []
    for i in range(len(boundOriginNodeID)):
        boundLowOriginNodeYC.append(0.0)
    boundUpOriginNodeZC = []
    for i in range(len(boundOriginNodeID)):
        boundUpOriginNodeZC.append(0.0)
    boundLowOriginNodeZC = []
    for i in range(len(boundOriginNodeID)):
        boundLowOriginNodeZC.append(0.0)
    BO.ID = boundOriginNodeID
    BO.UpX = boundUpOriginNodeXC
    BO.LowX = boundLowOriginNodeXC
    BO.UpY = boundUpOriginNodeYC
    BO.LowY = boundLowOriginNodeYC
    BO.UpZ = boundUpOriginNodeZC
    BO.LowZ = boundLowOriginNodeZC
# ---------- end cem_bound_origin_node ----------
cem_target = GhPythonScript(
    targetNode=flatten(targetnodes),
    targetNodeID=flatten(targetnodeid),
    targetNodeCoeff=flatten(Slider(1, range=0..10000)),
    targetVector=flatten(targetvector),
    targetVectorID=flatten(targetvectorid),
    targetVectorCoeffMag=flatten(targetvectorcoeffmag),
    targetVectorCoeffDir=flatten(targetvectorcoeffdir))  # -> TO; inputs targetNode: list, targetNodeID: list of Int32, targetVector: list of Vector3d, targetVectorID: list of Int32
# ---------- cem_target: Python ----------
"""
Assign targets
    Inputs:
        targetNode: (Point3D or Line or Surface) Describes the desired location of a node in the form diagram
        targetNodeID: (integer) The corresponding node ID
        targeNodeCoeff: (Float) The weight factor for matching target nodes
        targetVector: (Vector3D) Describes the desired trail vector in the force diagram
        targetVectorID: (integer) The corresponding trail edge ID
        targeVectorCoeffMag: (Float) The weight factor for matching the magnitude of the target vectors
        targeVectorCoeffDir: (Float) The weight factor for matching the direction of the target vectors
    Outputs:
        TO: (Targets) The assigned targets, their ID and weights.
    Remarks:
        This generates a new instance of targets for the optimization
"""



import Rhino


class TargetOpt(object):
    def __repr__(self):
        return self.ToString()
        
    def __str__(self):
        return self.ToString()
        
    def ToString(self):
        bl0_targetNode = False
        bl0_targetVector = False
        if targetNode and targetNodeID and len(targetNode) == len(targetNodeID):
                bl0_targetNode = True
        if targetVector and targetVectorID and len(targetVector) == len(targetVectorID):
                bl0_targetVector = True
        if bl0_targetNode and bl0_targetVector:
            return "Target Node and Target Vector"
        if bl0_targetNode and not bl0_targetVector:
            return "Target Node"
        if not bl0_targetNode and bl0_targetVector:
            return "Target Vector"
        else:
            return "No Target"

TO = TargetOpt()
if targetNode and targetNodeID and len(targetNode) == len(targetNodeID):
    TO.targetNode = targetNode
    TO.targetNodeID = targetNodeID
    TO.targetNodeCoeff = 0
    if targetNodeCoeff:
        TO.targetNodeCoeff = targetNodeCoeff

if targetVector and targetVectorID and len(targetVector) == len(targetVectorID):
    TO.targetVector = targetVector
    TO.targetVectorID = targetVectorID
    TO.targetVectorCoeffMag = 0
    TO.targetVectorCoeffDir = 0
    if targetVectorCoeffMag:
        TO.targetVectorCoeffMag = targetVectorCoeffMag
    if targetVectorCoeffDir:
        TO.targetVectorCoeffDir = targetVectorCoeffDir
# ---------- end cem_target ----------
cem_constraint_plane = GhPythonScript(
    constraintPlane=flatten(cem_extract_topology.constraintPlane),
    constraintPlaneID=flatten(cem_extract_topology.constraintPlaneID))  # -> CPL; inputs constraintPlane: list of Plane, constraintPlaneID: list of Int32
# ---------- cem_constraint_plane: Python ----------
"""
Assign self weight
    Inputs:
        selfWeight: (bool) Activate the self weight of the structure
        yieldStress: (double) The yield stress of the structural members
        specWeight: (double) The specific weight of the structural members
    Outputs:
        SW: (self-weight) The assigned self weight properties 
    Remarks:
        This generates a new instance of self weight
"""


import Rhino


class CPlane(object):
    def __repr__(self):
        return self.ToString()
        
    def __str__(self):
        return self.ToString()
        
    def ToString(self):
        if constraintPlane and len(constraintPlane) == len(constraintPlaneID):
            return str(len(constraintPlane)) + " Constraint Planes"
        else:
            return "Invalid Constraint Planes"



if constraintPlane:
    CPL = CPlane()
    CPL.constraintPlane = constraintPlane
    CPL.constraintPlaneID = constraintPlaneID
# ---------- end cem_constraint_plane ----------
cem_bound_trail = GhPythonScript(
    boundTrailID=flatten(boundtrailid),
    boundUpTrail=flatten(Slider(0, range=0..5000)),
    boundLowTrail=flatten(Slider(0, range=0..5000)))  # -> BT; inputs boundTrailID: list of Int32, boundUpTrail: list, boundLowTrail: list
# ---------- cem_bound_trail: Python ----------
"""
Assign bounds to trail lengths
    Inputs:
        boundTrailID: (integer) The trail edges ID that are allowed to change their length
        boundUpTrail: (float) The upper bound of allowable change of lengths for trail edges [m]
        boundLowTrail: (float) The lower bound of allowable change of lengths for trail edges [m]
    Outputs:
        BT: (Bounds Trail Lengths) The bounds for the trail edges lengths
    Remarks:
        This generates a new instance of bounds for the trail edges for the optimization
"""


import Rhino


class BoundTrail(object):
    def __repr__(self):
        return self.ToString()
        
    def __str__(self):
        return self.ToString()
        
    def ToString(self):
        return "Bound Trails"


BT = BoundTrail()
BT.ID = []
BT.Up = []
BT.Low = []


if boundTrailID:
    if len(boundTrailID) == len(boundUpTrail) and len(boundTrailID) == len(boundLowTrail):
        BT.ID = boundTrailID
        BT.Up = [abs(boundUpTrail_i) for boundUpTrail_i in boundUpTrail]
        BT.Low = [-abs(boundLowTrail_i) for boundLowTrail_i in boundLowTrail]
    elif len(boundUpTrail) == 1 and len(boundLowTrail) == 1:
        boundUpTrailC = []
        for i in range(len(boundTrailID)):
            boundUpTrailC.append(abs(boundUpTrail[0]))
        boundLowTrailC = []
        for i in range(len(boundTrailID)):
            boundLowTrailC.append(-abs(boundLowTrail[0]))
        BT.ID = boundTrailID
        BT.Up = boundUpTrailC
        BT.Low = boundLowTrailC
    else:
        boundUpTrailC = []
        for i in range(len(boundTrailID)):
            boundUpTrailC.append(0.0)
        boundLowTrailC = []
        for i in range(len(boundTrailID)):
            boundLowTrailC.append(0.0)
        BT.ID = boundTrailID
        BT.Up = boundUpTrailC
        BT.Low = boundLowTrailC
else:
    boundUpTrailC = []
    for i in range(len(boundTrailID)):
        boundUpTrailC.append(0.0)
    boundLowTrailC = []
    for i in range(len(boundTrailID)):
        boundLowTrailC.append(0.0)
    BT.ID = boundTrailID
    BT.Up = boundUpTrailC
    BT.Low = boundLowTrailC
# ---------- end cem_bound_trail ----------
cem_bound_deviation = GhPythonScript(
    boundDevID=flatten(bounddevid),
    boundUpDev=flatten(Slider(0, range=0..5000)),
    boundLowDev=flatten(Slider(20, range=0..5000)))  # -> BD; inputs boundDevID: list of Int32, boundUpDev: list, boundLowDev: list
# ---------- cem_bound_deviation: Python ----------
"""
Assign bounds to deviation forces
    Inputs:
        boundDevID: (integer) The deviation edges ID that are allowed to change their force magnitude
        boundUpDev: (float) The upper bound of allowable change of force magnitudes [kN]
        boundLowDev: (float) The lower bound of allowable change of force magnitudes [kN]
    Outputs:
        BD: (Bounds Deviation Edges) The bounds for the deviation edges force magnitudes
    Remarks:
        This generates a new instance of bounds for the deviation edges for the optimization
"""

import Rhino


class BoundDev(object):
    def __repr__(self):
        return self.ToString()
        
    def __str__(self):
        return self.ToString()
        
    def ToString(self):
        return "Bound Deviations"


BD = BoundDev()
BD.ID = []
BD.Up = []
BD.Low = []

if boundDevID:
    if len(boundDevID) == len(boundUpDev) and len(boundDevID) == len(boundLowDev):
        BD.ID = boundDevID
        BD.Up = [abs(boundUpDev_i) for boundUpDev_i in boundUpDev]
        BD.Low = [-abs(boundLowDev_i) for boundLowDev_i in boundLowDev]
    elif len(boundUpDev) == 1 and len(boundLowDev) == 1:
        boundUpDevC = []
        for i in range(len(boundDevID)):
            boundUpDevC.append(abs(boundUpDev[0]))
        boundLowDevC = []
        for i in range(len(boundDevID)):
            boundLowDevC.append(-abs(boundLowDev[0]))
        BD.ID = boundDevID
        BD.Up = boundUpDevC
        BD.Low = boundLowDevC
    else:
        boundUpDevC = []
        for i in range(len(boundDevID)):
            boundUpDevC.append(0.0)
        boundLowDevC = []
        for i in range(len(boundDevID)):
            boundLowDevC.append(0.0)
        BD.ID = boundDevID
        BD.Up = boundUpDevC
        BD.Low = boundLowDevC
else:
    boundUpDevC = []
    for i in range(len(boundDevID)):
        boundUpDevC.append(0.0)
    boundLowDevC = []
    for i in range(len(boundDevID)):
        boundLowDevC.append(0.0)
    BD.ID = boundDevID
    BD.Up = boundUpDevC
    BD.Low = boundLowDevC
# ---------- end cem_bound_deviation ----------
cem_origin_node = GhPythonScript(originNode=flatten(originnodes), originNodeID=flatten(cem_extract_topology.originNodeID))  # -> N; inputs originNode: list of Point3d, originNodeID: list of Int32
# ---------- cem_origin_node: Python ----------
"""
Locate origin nodes
    Inputs:
        originNode: (point3d) position of origin node in form diagram
        originNodeID: (integer) index of corresponding node
    Outputs:
        N: (origin-nodes) The assigned origin nodes
    Remarks:
        This generates a new instance of origin nodes
"""




import Rhino


class ONode(object):
    def __repr__(self):
        return self.ToString()
        
    def __str__(self):
        return self.ToString()
        
    def ToString(self):
        if originNode and len(originNode) == len(originNodeID):
            return str(len(originNode)) + " Defined Origin Nodes"
        else:
            return "Undefined Origin Nodes"



if originNode:
    N = ONode()
    N.originNode = originNode
    N.originNodeID = originNodeID
# ---------- end cem_origin_node ----------
cem_material_properties = GhPythonScript(selfWeight=self_weight, yieldStress=yieldstress_kn_m2, specWeight=specific_weight_kn_m3)  # -> SW; inputs selfWeight: Boolean
# ---------- cem_material_properties: Python ----------
"""
Assign self weight
    Inputs:
        selfWeight: (bool) Activate the self weight of the structure
        yieldStress: (double) The yield stress of the structural members
        specWeight: (double) The specific weight of the structural members
    Outputs:
        SW: (self-weight) The assigned self weight properties 
    Remarks:
        This generates a new instance of self weight
"""





import Rhino


class SWeight(object):
    def __repr__(self):
        return self.ToString()
        
    def __str__(self):
        return self.ToString()
        
    def ToString(self):
        if selfWeight and yieldStress and specWeight:
                return "Self Weight"
        else:
            return "No Self Weight"

SW = SWeight()
if selfWeight and yieldStress and specWeight:
    SW.yieldStress = yieldStress
    SW.specWeight = specWeight
# ---------- end cem_material_properties ----------
cem_optimization_setup = GhPythonScript(
    TO=cem_target,
    BO=cem_bound_origin_node,
    BT=cem_bound_trail,
    BD=cem_bound_deviation,
    gradientDelta=Slider(0.0001, range=0.0001..1),
    relativeTolerance=Slider(1e-06, range=1e-06..1),
    maxIterations=Slider(1, range=1..1000),
    optimAlgorithm=list)  # -> O; inputs maxIterations: Int32; disabled
# ---------- cem_optimization_setup: Python ----------
"""
Combines the Optimization settings
    Inputs:
        TO: (targets) The assigned targets, their ID and weights
        BO: (boundsoriginnodeObject) The bounds for the origin nodes
        BT: (boundstrailObject) The bounds for the trail edges lengths
        BD: (boundsdeviationObject) The bounds for the deviation edges force magnitudes
        gradientDelta: (float) The delta for the determination of the gradient through finite differences
        relativeTolerance: (float) The threshold which describes one stoping criteria
        maxIterations: (Integer) The maximum number of iteration steps
        optimAlgorithm: (AlgorithmType) The type of solver from the NLOpt library
    Outputs:
        O: (optimization set-up) The settings for an optimization that can be performed 
    Remarks:
        This generates a new instance of the optimization set-up
"""



import Rhino


class Opt(object):
    def __repr__(self):
        return self.ToString()
        
    def __str__(self):
        return self.ToString()
        
    def ToString(self):
        bl0_targetNode = False
        bl0_targetVector = False
        if TO and hasattr(TO, "targetNode") and hasattr(TO, "targetNodeID") and len(TO.targetNode) == len(TO.targetNodeID):
                bl0_targetNode = True
        if TO and hasattr(TO, "targetVector") and hasattr(TO, "targetVectorID") and len(TO.targetVector) == len(TO.targetVectorID):
                bl0_targetVector = True
        if bl0_targetNode and bl0_targetVector:
            return "Target Node and Target Vector"
        if bl0_targetNode and not bl0_targetVector:
            return "Target Node"
        if not bl0_targetNode and bl0_targetVector:
            return "Target Vector"
        else:
            return "No Target"

O = Opt()

if TO and hasattr(TO, "targetNode") and hasattr(TO, "targetNodeID"):
    O.targetNode = TO.targetNode
    O.targetNodeID = TO.targetNodeID
    O.targetNodeCoeff = TO.targetNodeCoeff
    
if TO and hasattr(TO, "targetVector") and hasattr(TO, "targetVectorID"):
    O.targetVector = TO.targetVector
    O.targetVectorID = TO.targetVectorID
    O.targetVectorCoeffMag = TO.targetVectorCoeffMag
    O.targetVectorCoeffDir = TO.targetVectorCoeffDir

if BO and hasattr(BO, "ID"):
    O.boundsOriginNodeID = BO.ID
    O.boundsOriginNodeUpX = BO.UpX
    O.boundsOriginNodeLowX = BO.LowX
    O.boundsOriginNodeUpY = BO.UpY
    O.boundsOriginNodeLowY = BO.LowY
    O.boundsOriginNodeUpZ = BO.UpZ
    O.boundsOriginNodeLowZ = BO.LowZ

if BT and hasattr(BT, "ID"):
    O.boundsTrailID = BT.ID
    O.boundsTrailUp = BT.Up
    O.boundsTrailLow = BT.Low

if BD and hasattr(BD, "ID"):
    O.boundsDevID = BD.ID
    O.boundsDevUp = BD.Up
    O.boundsDevLow = BD.Low

if gradientDelta is None:
    O.gradientDelta = 0.001
else:
    O.gradientDelta = gradientDelta

if relativeTolerance is None:
    O.relativeTolerance = 0.001
else:
    O.relativeTolerance = relativeTolerance

if maxIterations is None:
    O.maxIterations = 20
else:
    O.maxIterations = maxIterations

if optimAlgorithm is None:
    O.optimAlgorithm = "LN_BOBYQA"
else:
    O.optimAlgorithm = optimAlgorithm
# ---------- end cem_optimization_setup ----------

# ----
cem_calculate_structure = CEM_Calculate_Structure(
    TP=cem_build_topology.TP,
    CPL=cem_constraint_plane,
    N=cem_origin_node,
    SW=cem_material_properties,
    O=cem_optimization_setup)
cem_extract_structure = PythonScript(M=cem_calculate_structure)  # -> nodes, nodesID, trails, trailsID, trailsCol, trailsMag, deviations, deviationsID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
# ---------- cem_extract_structure: Python ----------
"""
Retrieves automatically the data in the structural model
    Inputs:
        M: (structural model) The calculated structural model (empty on error)
    Outputs:
        nodes: (point3D) The nodes of the structural model
        nodesID: (string) The IDs of the nodes
        trails: (line) The trail edges of the structural model
        trailsID: (string) The IDs of the trail edges
        trailsCol: (color) The colors of the trail edges
        trailsMag: (double) The magnitudes of the forces in the trail edges
        deviationDirect: (line) The direct deviation edges of the structural model
        deviationsDirectID: (string) The IDs of the direct deviation edges
        deviationDirectCol: (color) The colors of the direct deviation edges
        deviationDirectMag: (double) The magnitudes of the forces in the direct deviation edges
        deviationIndirect: (line) The indirect deviation edges of the structural model
        deviationsIndirectID: (string) The IDs of the indirect deviation edges
        deviationIndirectCol: (color) The colors of the indirect deviation edges
        deviationIndirectMag: (double) The magnitudes of the forces in the indirect deviation edges
        externalForces: (line) The external forces of the structural model
        externalForcesCol: (color) The colors of the external forces 
        externalForcesMag: (double) The magnitudes of the forces in the external forces 
    Remarks:
        This extract the data within the structural diagram
"""


if M and hasattr(M, "pt1_GlobNodeOut") and hasattr(M, "str1_NodeOrderOut") and hasattr(M, "ln1_GlobTrailEdgeOut") and hasattr(M, "cl1_GlobTrailEdgeOut") and hasattr(M, "db1_GlobTrailEdgeOut") and hasattr(M, "ln1_GlobDeviation1EdgeOut") and hasattr(M, "cl1_GlobDeviation1EdgeOut") and hasattr(M, "db1_GlobDeviation1EdgeOut") and hasattr(M, "ln1_GlobDeviation2EdgeOut") and hasattr(M, "cl1_GlobDeviation2EdgeOut") and hasattr(M, "db1_GlobDeviation2EdgeOut") and hasattr(M, "ln1_GlobExtFOEdgeOut") and hasattr(M, "cl1_GlobExtFOEdgeOut") and hasattr(M, "db1_GlobExtFOEdgeOut"):

    nodes_C = []
    nodesID_C = []
    for i in range(len(M.pt1_GlobNodeOut)):
        if M.str1_NodeOrderOut[i][0] != "L":
            nodes_C.append(M.pt1_GlobNodeOut[i])
            nodesID_C.append(M.str1_NodeOrderOut[i])
        nodes = nodes_C
        nodesID = nodesID_C
        
    trails_C = []
    trailsID_C = []
    trailsCol_C = []
    trailsMag_C = []
    for i in range(len(M.ln1_GlobTrailEdgeOut)):
        if M.str1_GlobTrailEdgeOut[i][0] != "E":
            trails_C.append(M.ln1_GlobTrailEdgeOut[i])
            trailsID_C.append(M.str1_GlobTrailEdgeOut[i])
            trailsCol_C.append(M.cl1_GlobTrailEdgeOut[i])
            trailsMag_C.append(M.db1_GlobTrailEdgeOut[i])
        trails = trails_C
        trailsID = trailsID_C
        trailsCol = trailsCol_C
        trailsMag = trailsMag_C
        
    deviationsDirect = M.ln1_GlobDeviation1EdgeOut
    deviationsDirectID = M.str1_GlobDeviation1EdgeOut
    deviationsDirectCol = M.cl1_GlobDeviation1EdgeOut
    deviationsDirectMag = M.db1_GlobDeviation1EdgeOut
    deviationsIndirect = M.ln1_GlobDeviation2EdgeOut
    deviationsIndirectID = M.str1_GlobDeviation2EdgeOut
    deviationsIndirectCol = M.cl1_GlobDeviation2EdgeOut
    deviationsIndirectMag = M.db1_GlobDeviation2EdgeOut
    deviations = M.ln1_GlobDeviationEdgeOut
    deviationsID = M.str1_GlobDeviationEdgeOut
    deviationsCol = M.cl1_GlobDeviationEdgeOut
    deviationsMag = M.db1_GlobDeviationEdgeOut
    externalForces = M.ln1_GlobExtFOEdgeOut
    externalForcesCol = M.cl1_GlobExtFOEdgeOut
    externalForcesMag = M.db1_GlobExtFOEdgeOut
# ---------- end cem_extract_structure ----------

# ---- group: Postprocessing
sc = Slider(0.007, range=0..1)
S = Slider(2, range=0..10)
st = Slider(0.04, range=0..1)
cem_skeleton = CEM_Skeleton(
    trails=cem_extract_structure.trails,
    trailsmag=cem_extract_structure.trailsMag,
    deviations=cem_extract_structure.deviations,
    deviationsmag=cem_extract_structure.deviationsMag,
    B=sc,
    L=S,
    R=st)  # -> S, P
preview = CustomPreview(
    Geometry=cem_skeleton.S,
    Material={diffuse=RGB(105, 105, 105), emission=RGB(0, 0, 0), shine=0, specular=RGB(255, 255, 255), transparency=0})
preview_2 = CustomPreview(
    Geometry=cem_skeleton.P,
    Material={diffuse=RGB(105, 105, 105), emission=RGB(0, 0, 0), shine=0, specular=RGB(255, 255, 255), transparency=0})

# ----
nodes_all = Point(cem_extract_structure.nodes)
trails_all = Line(cem_extract_structure.trails)
form_diagram = CustomPreview(
    Geometry=[cem_extract_structure.trails, cem_extract_structure.deviations],
    Material=[cem_extract_structure.trailsCol, cem_extract_structure.deviationsCol])

lines = Merge(Data1=cem_extract_structure.trails, Data2=cem_extract_structure.deviations)
# Branch-node matrix
pt_totest = Point(nodes_all)
line = Line(lines)
cluster = Cluster(S=pt_totest, C=line)  # -> S_2, out
eval = EvaluateCurve(Curve=line, Parameter=0.5)  # -> Point, Tangent, Angle
lng_2 = ListLength(List=eval.Point)
series_2 = Series(Start=0, Step=1, Count=lng_2)
partition_2 = PartitionList(List=cluster.out, Size=2)
tag_2 = TextTag(Location=eval.Point, Text=series_2)
tag_3 = TextTag(Location=pt_totest, Text=cluster.S_2)
panel_2 = Panel(partition_2)
branch_node = Panel(cluster.out)

pdecon = Deconstruct(Point=nodes_all)  # -> XComponent, YComponent, ZComponent
len = Length(Curve=cem_extract_structure.trails)
len_2 = Length(Curve=cem_extract_structure.deviations)
floorheights_2 = Number(value_generator.db1_FloorHeightsOut)
nn = ListLength(List=nodes_all)
nt = ListLength(List=cem_extract_structure.trails)
nd = ListLength(List=cem_extract_structure.deviations)
loadx = Number(number_slider_2)
loadz = Number(number_slider_4)
posy = Number(pdecon.YComponent)
posz = Number(pdecon.ZComponent)
devlen = Number(len_2)
# Output Vector
nf = Integer(value_generator.int0_Floors)
gridx = Integer(value_generator.db1_GridXOut)
gridy = Integer(value_generator.db1_GridYOut)
loady = Number(number_slider_3)
posx = Number(pdecon.XComponent)
tralen = Number(len)
tramag = Number(cem_extract_structure.trailsMag)
devmag = Number(cem_extract_structure.deviationsMag)
abs = Absolute(Value=[tramag, devmag])
multiplication = Multiplication(A=[tralen, devlen], B=abs)
totlp = MassAddition(Input=multiplication)  # -> Result, PartialResults
# # number of floors -> nF (1) input
# # number of nodes -> nN (1) output
# # number of trail edges -> nT (1) output
# # number of deviation edges -> nD (1) output
# # grid size X -> gridX (1) input
# # grid size Y -> gridY (1) input
# # load X -> loadX (1) input
# # load Y -> loadY (1) input
# # load Z -> loadZ (1) input
# # load path -> totLP (1) output
# # floor heights -> hFl (nF) input
# # nodes position X -> posX (nN) output
# # nodes position Y -> posX (nN) output
# # nodes position Z -> posX (nN) output
# # trail lenghts -> traLen (nT) output
# # trail magnitudes -> traMag (nT) output
# # deviation lenghts -> devLen (nD) output
# # deviation magnitudes -> devMag (nD) input
output_vector = Entwine(
    Branch00=nf,
    Branch01=nn,
    Branch02=nt,
    Branch03=nd,
    Branch04=gridx,
    Branch05=gridy,
    Branch06=loadx,
    Branch07=loady,
    Branch08=loadz,
    Branch09=totlp.Result,
    Branch010=floorheights_2,
    Branch011=posx,
    Branch012=posy,
    Branch013=posz,
    Branch014=tralen,
    Branch015=tramag,
    Branch016=devlen,
    Branch017=devmag,
    FlattenInputs=True)  # -> flatten(Result)

panel_3 = Panel(floorheights_2)
panel_4 = Panel(gridy)
panel_5 = Panel(devmag)
panel_6 = Panel(gridx)
panel_7 = Panel(output_vector)
# Data-set recording
panel_8 = Panel(output_vector)

# ---- group: Data-set _recording
csv_writer_branch_node = GhPythonScript(y=cluster.out, n0="Admin", n2="210427_data_00_branch-node_CEM.csv")  # inputs y: list; disabled
# ---------- csv_writer_branch_node: Python ----------
import os
import csv


with open(os.path.join('C:\\Users\\' + n0 + '\\Desktop\\AAG2020_WS4\\CEM\\Topology', n2), "w") as csvfile1:
    
    check = None in y
    if check == False:
        if len(y) != 0 :
            writer = csv.writer(csvfile1, delimiter=',')
            writer.writerow(y)
# ---------- end csv_writer_branch_node ----------
csv_writer = GhPythonScript(x=panel_8, n0="Admin", n1="210427_data_00_CEM.csv")  # inputs x: list; disabled
# ---------- csv_writer: Python ----------
import os
import csv


with open(os.path.join('C:\\Users\\' + n0 + '\\Desktop\\AAG2020_WS4\\CEM\\Data', n1), "a") as csvfile1:
    
    check = None in x
    if check == False:
        if len(x) != 0 :
            writer = csv.writer(csvfile1, delimiter=',')
            writer.writerow(x)
# ---------- end csv_writer ----------

# ----
# Start data-set production
timer = Timer(Interval=2, TimerInterval=5, Target=value_generator)  # disabled

# ----
# Visualization
number_slider_6 = Slider(-0.5, range=-1..2)
additional_wall_length = Slider(0.6, range=0..3)
trails_all_2 = Line(trails_all)
num = Number(number_slider_6)
num_2 = Number(additional_wall_length)
end_2 = EndPoints(Curve=trails_all_2)  # -> flatten(Start), flatten(End)
eval_2 = EvaluateCurve(Curve=reparameterize(trails_all_2), Parameter=0.5)  # -> Point, Tangent, Angle
pt_4 = Point(end_2.Start)
pt_5 = Point(end_2.End)
vec2pt = Vector2Pt(PointA=eval_2.Point, PointB=pt_4, Unitize=False)  # -> Vector, Length
vec2pt_2 = Vector2Pt(PointA=eval_2.Point, PointB=pt_5, Unitize=False)  # -> Vector, Length
devec = DeconstructVector(Vector=vec2pt.Vector)  # -> XComponent, YComponent, ZComponent
devec_2 = DeconstructVector(Vector=vec2pt_2.Vector)  # -> XComponent, YComponent, ZComponent
vec = VectorXYZ(XComponent=devec.XComponent, YComponent=devec.YComponent, ZComponent=0)  # -> Vector, Length
vec_2 = VectorXYZ(XComponent=devec_2.XComponent, YComponent=devec_2.YComponent, ZComponent=0)  # -> Vector, Length
unit = UnitVector(Vector=vec.Vector)
unit_2 = UnitVector(Vector=vec_2.Vector)
num_3 = Number(num_2)
trailcrv = Curve(trails_all_2)
rev_2 = Reverse(Vector=unit)
rev_3 = Reverse(Vector=unit_2)
end_3 = EndPoints(Curve=trailcrv)  # -> flatten(Start), flatten(End)
eval_3 = EvaluateCurve(Curve=reparameterize(trailcrv), Parameter=0.5)  # -> Point, Tangent, Angle
line_2 = LineSDL(Start=pt_4, Direction=unit, Length=num_2)
line_3 = LineSDL(Start=pt_4, Direction=rev_2, Length=num_2)
line_4 = LineSDL(Start=pt_5, Direction=unit_2, Length=num_2)
line_5 = LineSDL(Start=pt_5, Direction=rev_3, Length=num_2)
end_4 = EndPoints(Curve=line_2)  # -> Start, End
end_5 = EndPoints(Curve=line_3)  # -> Start, End
end_6 = EndPoints(Curve=line_4)  # -> Start, End
end_7 = EndPoints(Curve=line_5)  # -> Start, End
pt_6 = Point(end_3.Start)
pt_7 = Point(end_3.End)
vec2pt_3 = Vector2Pt(PointA=eval_3.Point, PointB=pt_6, Unitize=False)  # -> Vector, Length
vec2pt_4 = Vector2Pt(PointA=eval_3.Point, PointB=pt_7, Unitize=False)  # -> Vector, Length
pdecon_2 = Deconstruct(Point=end_5.End)  # -> XComponent, YComponent, ZComponent
pdecon_3 = Deconstruct(Point=end_4.End)  # -> XComponent, YComponent, ZComponent
pdecon_4 = Deconstruct(Point=end_6.End)  # -> XComponent, YComponent, ZComponent
pdecon_5 = Deconstruct(Point=end_7.End)  # -> XComponent, YComponent, ZComponent
pt_8 = ConstructPoint(XCoordinate=pdecon_4.XComponent, YCoordinate=pdecon_4.YComponent, ZCoordinate=pdecon_2.ZComponent)
pt_9 = ConstructPoint(XCoordinate=pdecon_3.XComponent, YCoordinate=pdecon_3.YComponent, ZCoordinate=pdecon_5.ZComponent)
devec_3 = DeconstructVector(Vector=vec2pt_3.Vector)  # -> XComponent, YComponent, ZComponent
devec_4 = DeconstructVector(Vector=vec2pt_4.Vector)  # -> XComponent, YComponent, ZComponent
merge_2 = Merge(Data1=end_4.End, Data2=pt_8, Data3=end_6.End, Data4=pt_9)
vec_3 = VectorXYZ(XComponent=devec_3.XComponent, YComponent=devec_3.YComponent, ZComponent=0)  # -> Vector, Length
vec_4 = VectorXYZ(XComponent=devec_4.XComponent, YComponent=devec_4.YComponent, ZComponent=0)  # -> Vector, Length
unit_3 = UnitVector(Vector=vec_3.Vector)
unit_4 = UnitVector(Vector=vec_4.Vector)
cullpt = CullDuplicates(Points=merge_2, Tolerance=0.1, CullMode=3)  # -> Points, Indices, Valence
rev_4 = Reverse(Vector=unit_3)
rev_5 = Reverse(Vector=unit_4)
pt_10 = Point(cullpt.Points)
project = Project(Geometry=pt_10, Plane=PlaneXY(0, 0, 0))  # -> Geometry, Transform
pdecon_6 = Deconstruct(Point=pt_4)  # -> XComponent, YComponent, ZComponent
hull = ConvexHull(Points=flatten(project.Geometry), Plane=PlaneXY(0, 0, 0))  # -> Hull, HullZ, Indices
pt_11 = ConstructPoint(XCoordinate=0, YCoordinate=0, ZCoordinate=pdecon_6.ZComponent)
line_6 = LineSDL(Start=pt_6, Direction=unit_3, Length=num_3)
line_7 = LineSDL(Start=pt_6, Direction=rev_4, Length=num_3)
line_8 = LineSDL(Start=pt_7, Direction=unit_4, Length=num_3)
line_9 = LineSDL(Start=pt_7, Direction=rev_5, Length=num_3)
offset = OffsetCurve(Curve=hull.Hull, Distance=num, Plane=PlaneXY(0, 0, 0), Corners=1)
end_8 = EndPoints(Curve=line_6)  # -> Start, End
end_9 = EndPoints(Curve=line_7)  # -> Start, End
end_10 = EndPoints(Curve=line_8)  # -> Start, End
end_11 = EndPoints(Curve=line_9)  # -> Start, End
boundary = BoundarySurfaces(Edges=offset)
inclined_column = _4PointSurface(CornerA=end_8.End, CornerB=end_9.End, CornerC=end_10.End, CornerD=end_11.End)
# Type here the floor heights
# CEM - Release 1.75
# Type here the pattern for each slab (between 0 and 3, only integer) -
# Number of elements should be the same as in the floor height list
walls = _4PointSurface(CornerA=end_4.End, CornerB=pt_8, CornerC=end_6.End, CornerD=pt_9)

duppt = RemoveDuplicatePts(Points=pt_11, Tolerance=0.01)

pdecon_7 = Deconstruct(Point=duppt)  # -> XComponent, YComponent, ZComponent
Z_2 = UnitZ(Factor=pdecon_7.ZComponent)
slabs = Move(Geometry=boundary, Motion=Z_2)  # -> Geometry, Transform

# ==== cluster Cluster
S = ClusterInput()
C = ClusterInput()
lng = ListLength(List=S)
end = EndPoints(Curve=C)  # -> Start, End
panel = Panel(end.Start)
series = Series(Start=0, Step=1, Count=lng)
fsim = FindSimilarMember(Data=end.Start, Set=S)  # -> Hit, Index
python = GhPythonScript(x=S, y=end.Start, z=end.End)  # -> out, a; inputs x: list of Point3d, y: list of Point3d, z: list of Point3d
# ---------- python: Python ----------
__author__ = "bertagnf"
__version__ = "2021.04.13"

import rhinoscriptsyntax as rs

allp = x
startp = y
endp = z

for i in range(0, len(startp)):
    if startp[i] in allp and endp[i] in allp:
        print allp.index(startp[i])
        print allp.index(endp[i])
# ---------- end python ----------
fsim_2 = FindSimilarMember(Data=end.End, Set=S)  # -> Hit, Index
S_2 = ClusterOutput(series)
merge = Merge(Data1=graft(fsim.Index), Data2=graft(fsim_2.Index))  # -> flatten(Result)
panel_2 = Panel(python.out)
panel_3 = Panel(merge)
out = ClusterOutput(python.out)

# ==== cluster CEM_Skeleton
trails = ClusterInput()
trailsmag = ClusterInput()
deviations = ClusterInput()
deviationsmag = ClusterInput()
python = GhPythonScript(trails=trails, trailsMag=trailsmag, deviations=deviations, deviationsMag=deviationsmag)  # -> out, T, C, B, R; inputs trails: list of Line, trailsMag: list, deviations: list of Line, deviationsMag: list
# ---------- python: Python ----------
import Rhino as rh
import rhinoscriptsyntax as rs

tension = []
tensionMag = []
compression = []
compressionMag = []

nodes = []
radius = []

for i in range(len(trails)):
    if trailsMag[i] > 0:
        tension.append(trails[i])
        tensionMag.append(trailsMag[i])
    else:
        compression.append(trails[i])
        compressionMag.append(abs(trailsMag[i]))
        node = trails[i].From
        if node in nodes:
            nodeIndex = nodes.index(node)
            if -trailsMag[i] > radius[nodeIndex]:
                radius[nodeIndex] = -trailsMag[i] 
        else:
            nodes.append(trails[i].From)
            radius.append(-trailsMag[i])
        node = trails[i].To
        if node in nodes:
            nodeIndex = nodes.index(node)
            if -trailsMag[i] > radius[nodeIndex]:
                radius[nodeIndex] = -trailsMag[i] 
        else:
            nodes.append(trails[i].To)
            radius.append(-trailsMag[i])

for i in range(len(deviations)):
    if deviationsMag[i] > 0:
        tension.append(deviations[i])
        tensionMag.append(deviationsMag[i])
    else:
        compression.append(deviations[i])
        compressionMag.append(abs(deviationsMag[i]))
        node = deviations[i].From
        if node in nodes:
            nodeIndex = nodes.index(node)
            if deviationsMag[i] > radius[nodeIndex]:
                radius[nodeIndex] = deviationsMag[i] 
        else:
            nodes.append(deviations[i].From)
            radius.append(deviationsMag[i])
        node = deviations[i].To
        if node in nodes:
            nodeIndex = nodes.index(node)
            if deviationsMag[i] > radius[nodeIndex]:
                radius[nodeIndex] = deviationsMag[i] 
        else:
            nodes.append(deviations[i].To)
            radius.append(deviationsMag[i])

T = tension
C = compression
B = nodes
R = radius
# ---------- end python ----------
B = ClusterInput()
multiplication = Multiplication(A=python.R, B=B)
R = ClusterInput()
L = ClusterInput()
sph = Sphere(Base=python.B, Radius=multiplication)
pipe = Pipe(Curve=python.T, Radius=R, Caps=0)  # -> flatten(Pipe)
F = Fatten(Skeleton=python.C, Spheres=sph, Thickness=0.1, LengthSubdivisions=L, EndType=0, AdjustForAngle=False)
P = ClusterOutput(pipe)
subdmesh = SubDFromMesh(Mesh=F, Creases=1, Corners=1, Interpolate=False)
S = ClusterOutput(subdmesh)
